# Grasshopper definition 01_ReuseConcrete_SortingandGrouping_RH7.gh (Grasshopper 1.0.7)
# plug-ins: Kangaroo2 Components, RhinoCodePluginGH

mesh = Mesh([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])
nv = NakedVertices(Mesh=mesh)  # -> ClothedIndex, NakedIndex, ClothedPts, NakedPts
project = Project(Geometry=nv.ClothedPts, Plane=PlaneXY(0, 0, 0))  # -> Geometry, Transform
number_slider = Slider(1, range=0..10)
hull = ConvexHull(Points=project.Geometry, Plane=PlaneXY(0, 0, 0))  # -> Hull, HullZ, Indices
crv = Curve(hull.Hull)
disc = Discontinuity(Curve=crv, Level=1)  # -> Points, Parameters
shatter = Shatter(Curve=graft(crv), Parameters=disc.Parameters)
number_slider_2 = Slider(1, range=0..1)

# ---- group: Layout interval
# Lay in the way that mass centre is the closest to the ground
number_slider_3 = Slider(2000, range=0..2000)

# ----
number_slider_4 = Slider(1, range=0..1)

# ---- group: Layout interval
number_slider_5 = Slider(2, range=0..10)

# ----
# Cull the ones that are not stable
panel = Panel("""0
1""")
file_name = Data(["RC_00", "RC_01", "RC_02", "RC_03", "RC_04", "RC_05", "RC_06", "RC_07", "RC_08", "RC_09", "RC_10"])
file_name_2 = Data(["RC_00", "RC_01", "RC_02", "RC_03", "RC_04", "RC_05", "RC_06", "RC_07", "RC_08", "RC_09", "RC_10"])
# FileName
merge = Merge(Data1=file_name_2, Data2=file_name)
number_slider_6 = Slider(100, range=0..100)
number_slider_7 = Slider(4, range=0..10)

lng = ListLength(List=shatter)  # -> simplify(Length)

len = Length(Curve=shatter)
sort = SortList(Keys=len, ValuesA=shatter)  # -> Keys, ValuesA
item = ListItem(List=sort.ValuesA, Index=0, Wrap=True)  # -> Item1, Item
# Lay on the longest straight edge
area = Area(Geometry=crv)  # -> Area, Centroid
crv_2 = Curve(item.Item1)
end = EndPoints(Curve=crv_2)  # -> Start, End
ln = Line(StartPoint=end.Start, EndPoint=end.End)
lnpt = LinePt(Line=ln, Point=area.Centroid)  # -> simplify(flatten(Plane))

ext = ExtendCurve(Curve=ln, Type=0, Start=number_slider_2, End=number_slider_2)
lng_2 = ListLength(List=flatten(ln))
crv_cp = CurveClosestPoint(Point=area.Centroid, Curve=ext)  # -> Point, Parameter, Distance
series = Series(Start=0, Step=number_slider_3, Count=lng_2)  # -> simplify(Series)
ln_2 = Line(StartPoint=area.Centroid, EndPoint=crv_cp.Point)
pt = ConstructPoint(XCoordinate=series, YCoordinate=0, ZCoordinate=0)
xy = XYPlane(Origin=pt)

dup = DuplicateData(Data=area.Centroid, Number=lng, Order=True)
pull = PullPoint(Point=simplify(graft(dup)), Geometry=simplify(graft(shatter)), ClosestOnly=True)  # -> ClosestPoint, Distance
trim = TrimTree(Tree=pull.ClosestPoint, Depth=1)
pt_2 = Point(trim)
ln_3 = Line(StartPoint=area.Centroid, EndPoint=pt_2)
len_2 = Length(Curve=ln_3)
sort_2 = SortList(Keys=len_2, ValuesA=shatter)  # -> Keys, ValuesA
sort_3 = SortList(Keys=len_2, ValuesA=pt_2)  # -> Keys, ValuesA
sort_4 = SortList(Keys=len_2, ValuesA=ln_3)  # -> Keys, ValuesA
item_2 = ListItem(List=sort_2.ValuesA, Index=0, Wrap=True)  # -> simplify(Item)
item_3 = ListItem(List=simplify(sort_3.ValuesA), Index=0, Wrap=True)
item_4 = ListItem(List=simplify(sort_4.ValuesA), Index=0, Wrap=True)
end_2 = EndPoints(Curve=item_2)  # -> Start, End
ln_4 = Line(StartPoint=end_2.Start, EndPoint=end_2.End)
lnln = LineLine(LineA=item_4, LineB=ln_4)
rotate = Rotate(Geometry=xy, Angle=degrees("-90"), Plane=xy)  # -> Geometry, Transform
pl_origin = PlaneOrigin(Base=lnln, Origin=end_2.Start)
# Polyline Outline
orient = Orient(Geometry=flatten(crv), Source=flatten(pl_origin), Target=rotate.Geometry)  # -> Geometry, Transform

end_3 = EndPoints(Curve=item_4)  # -> Start, End
rotate_2 = Rotate(Geometry=xy, Angle=degrees("0"), Plane=xy)  # -> Geometry, Transform

# ----
# Polyline Outline
orient_2 = Orient(Geometry=flatten(crv), Source=lnpt, Target=rotate_2.Geometry)  # -> Geometry, Transform

# ----
# Original Mesh
orient_3 = Orient(Geometry=flatten(mesh), Source=lnpt, Target=rotate_2.Geometry)  # -> Geometry, Transform
# Line of Gravity
orient_4 = Orient(Geometry=flatten(ln_2), Source=lnpt, Target=rotate_2.Geometry)  # -> Geometry, Transform
preview = CustomPreview(Geometry=orient_3.Geometry, Material=ColourSwatch(SwatchColor=RGBA(87, 87, 87, 92)))
# Original Mesh
orient_5 = Orient(Geometry=flatten(mesh), Source=flatten(pl_origin), Target=rotate.Geometry)  # -> Geometry, Transform
# Line of Gravity
orient_6 = Orient(Geometry=flatten(item_4), Source=flatten(pl_origin), Target=rotate.Geometry)  # -> Geometry, Transform
preview_2 = CustomPreview(Geometry=orient_5.Geometry, Material=ColourSwatch(SwatchColor=RGBA(83, 84, 87, 92)))
# Polyline Outline
merge_2 = Merge(Data1=flatten(orient_2.Geometry), Data2=flatten(orient.Geometry))
# Mesh
merge_3 = Merge(Data1=flatten(orient_3.Geometry), Data2=flatten(orient_5.Geometry))
disc_2 = Discontinuity(Curve=merge_2, Level=1)  # -> Points, Parameters
pdecon = Deconstruct(Point=disc_2.Points)  # -> XComponent, YComponent, ZComponent
sort_5 = SortList(Keys=pdecon.YComponent)  # -> Keys, ValuesA
sort_6 = SortList(Keys=pdecon.YComponent, ValuesA=disc_2.Points)  # -> Keys, ValuesA
# Finding height
item_5 = ListItem(List=sort_5.Keys, Index=0, Wrap=True)  # -> flatten(Item1), simplify(Item)
item_6 = ListItem(List=sort_6.ValuesA, Index=0, Wrap=True)  # -> flatten(Item1), simplify(Item)
subtraction = Subtraction(A=item_5.Item1, B=flatten(item_5.Item))
# Best Fit Grouping
py3 = Python3Script(numbers=subtraction, num_groups=number_slider_7, tolerance=number_slider_6)  # -> out, groups, leftovers, a; inputs numbers: list of Double, num_groups: Int32, tolerance: Double
# ---------- py3: Python ----------
import rhinoscriptsyntax as rs
import ghpythonlib.components as ghcomp
from Grasshopper import DataTree
from Grasshopper.Kernel.Data import GH_Path

def best_fit_grouping_hierarchical(numbers, num_groups, tolerance):
    # Sort numbers along with their indices
    indexed_numbers = sorted(enumerate(numbers), key=lambda x: x[1])
    
    # Initialize groups, with each number starting in its own group
    groups = [[(idx, num)] for idx, num in indexed_numbers]
    
    # Function to calculate the difference between two groups
    def group_difference(g1, g2):
        return abs(g1[-1][1] - g2[0][1])
    
    # Hierarchical clustering until we reach the target number of groups
    while len(groups) > num_groups:
        # Find the closest pair of groups
        min_diff = float('inf')
        min_pair = (0, 1)
        
        for i in range(len(groups) - 1):
            diff = group_difference(groups[i], groups[i + 1])
            if diff < min_diff:
                min_diff = diff
                min_pair = (i, i + 1)
        
        # Merge the closest pair of groups
        i, j = min_pair
        groups[i].extend(groups[j])
        del groups[j]  # Remove the merged group
    
    # Final tolerance check: separate items exceeding the tolerance
    final_groups = []
    leftovers = []
    
    for group in groups:
        valid_group = [group[0]]
        for item in group[1:]:
            if abs(item[1] - valid_group[-1][1]) <= tolerance:
                valid_group.append(item)
            else:
                leftovers.append(item)
        final_groups.append(valid_group)
    
    return final_groups, leftovers




groups, leftovers = best_fit_grouping_hierarchical(numbers, num_groups, tolerance)

# Output to Grasshopper using DataTree
output_groups = DataTree[object]()
for i, group in enumerate(groups):
    path = GH_Path(i)
    for idx, value in group:
        output_groups.Add((idx, value), path)  # Add tuples of (index, value) to each branch

# Leftovers in a separate flat list, also with (index, value) format
output_leftovers = DataTree[object]()
for idx, value in leftovers:
    output_leftovers.Add((idx, value), GH_Path(0))

# Grasshopper outputs
groups = output_groups  # Groups with index and value
leftovers = output_leftovers  # Leftovers with index and value
# ---------- end py3 ----------
python = GhPythonScript(numbers=subtraction, num_groups=number_slider_7, tolerance=number_slider_6)  # -> out, groups, leftovers, a; inputs numbers: list, num_groups: Int32; same code as py3
split = TextSplit(Text=python.groups, Separators="(,)")
item_7 = ListItem(List=split, Index=0, Wrap=True)  # -> Item, Item1, Item2
# Indices
trim_2 = TrimTree(Tree=item_7.Item1, Depth=1)
# Values
trim_3 = TrimTree(Tree=item_7.Item2, Depth=1)
cluster = Cluster(L=Slider(3, range=0..10), L_3=item_6.Item, L_4=merge_3, num=trim_2, num_2=trim_3, L_5=merge_2, L_2=merge)  # -> pt_2, D, move_vector_2, grouped_mesh_2, grouped_polylines_2, data_2
data = Data(cluster.data_2)
# Arrange different groups in different rows for visualization
grouped_mesh = Mesh(cluster.grouped_mesh_2)
grouped_polylines = Curve(cluster.grouped_polylines_2)
panel_2 = Panel(data)
concat = Concatenate(FragmentA=cluster.D, FragmentB="m")
move = Move(Geometry=grouped_mesh, Motion=cluster.move_vector_2)  # -> Geometry, Transform
tag = TextTag(Location=flatten(cluster.pt_2), Text=flatten(concat))

len_3 = Length(Curve=shatter)
sort_7 = SortList(Keys=len_3, ValuesA=shatter)  # -> Keys, ValuesA
item_8 = ListItem(List=sort_7.ValuesA, Index=0, Wrap=True)  # -> Item2, Item1, Item
# Lay on the Second longest straight edge
area_2 = Area(Geometry=crv)  # -> Area, Centroid
crv_3 = Curve(item_8.Item2)
end_4 = EndPoints(Curve=crv_3)  # -> Start, End
ln_5 = Line(StartPoint=end_4.Start, EndPoint=end_4.End)
lnpt_2 = LinePt(Line=ln_5, Point=area_2.Centroid)  # -> simplify(flatten(Plane))

ext_2 = ExtendCurve(Curve=ln_5, Type=0, Start=number_slider_4, End=number_slider_4)
crv_cp_2 = CurveClosestPoint(Point=area_2.Centroid, Curve=ext_2)  # -> Point, Parameter, Distance
lng_3 = ListLength(List=flatten(ln_5))
ln_6 = Line(StartPoint=area_2.Centroid, EndPoint=crv_cp_2.Point)
series_2 = Series(Start=0, Step=number_slider_5, Count=lng_3)  # -> simplify(Series)
pt_3 = ConstructPoint(XCoordinate=series_2, YCoordinate="-3", ZCoordinate=0)
xy_2 = XYPlane(Origin=pt_3)
rotate_3 = Rotate(Geometry=xy_2, Angle=degrees("0"), Plane=xy_2)  # -> Geometry, Transform
# Original Mesh
orient_7 = Orient(Geometry=flatten(mesh), Source=lnpt_2, Target=rotate_3.Geometry)  # -> Geometry, Transform
orient_8 = Orient(Geometry=flatten(ln_6), Source=lnpt_2, Target=rotate_3.Geometry)  # -> Geometry, Transform

# ----
# Polyline Outline
orient_9 = Orient(Geometry=flatten(crv), Source=lnpt_2, Target=rotate_3.Geometry)  # -> Geometry, Transform

cull_i = CullIndex(List=orient_9.Geometry, Indices=panel, Wrap=True)
cull_i_2 = CullIndex(List=orient_7.Geometry, Indices=panel, Wrap=True)

# ==== cluster Cluster
# Mesh
num = ClusterInput()
num_2 = ClusterInput()
num_3 = Number(num)
num_4 = Number(num_2)
avr = Average(Input=num_4)
L = ClusterInput()
item = ListItem(List=L, Index=num_3, Wrap=True)
roundd = RoundToDecimalPlace(NumberX=avr, DecimalPlace=L, RoundType=0)  # -> Rounded, Difference
tstat = TreeStatistics(Tree=simplify(item))  # -> Paths, Length, Count
dpath = DeconstructPath(Branch=tstat.Paths)
sort = SortList(Keys=flatten(roundd.Rounded), ValuesA=flatten(dpath))  # -> Keys, graft(ValuesA)
path = ConstructPath(Indices=sort.ValuesA)  # -> simplify(Branch)
replace = ReplacePaths(Data=num_3, Search=flatten(path), Replace=tstat.Paths)
L_2 = ClusterInput()
L_3 = ClusterInput()
L_4 = ClusterInput()
L_5 = ClusterInput()
multiplication = Multiplication(A=dpath, B=Slider(2000, range=0..10000))
item_2 = ListItem(List=flatten(L_3), Index=replace, Wrap=True)
item_3 = ListItem(List=L_4, Index=replace, Wrap=True)
item_4 = ListItem(List=L_5, Index=replace, Wrap=True)
item_5 = ListItem(List=L_2, Index=replace, Wrap=True)
grouped_mesh = Mesh(item_3)
grouped_polylines = Curve(item_4)
pdecon = Deconstruct(Point=item_2)  # -> XComponent, YComponent, ZComponent
pt = ConstructPoint(XCoordinate="-2000", YCoordinate=multiplication, ZCoordinate=0)
replace_2 = ReplacePaths(Data=simplify(roundd.Rounded), Search=flatten(path), Replace=flatten(dpath))
data = Data(item_5)
grouped_mesh_2 = ClusterOutput(grouped_mesh)
grouped_polylines_2 = ClusterOutput(grouped_polylines)
data_2 = ClusterOutput(data)
pt_2 = ClusterOutput(pt)
D = ClusterOutput(replace_2)
pt_3 = ConstructPoint(XCoordinate=pdecon.XComponent, YCoordinate=multiplication, ZCoordinate=0)
ln = Line(StartPoint=item_2, EndPoint=simplify(pt_3))
move_vector = Line(ln)
move_vector_2 = ClusterOutput(move_vector)
