# Grasshopper definition 02_ReuseConcrete_HungarianAlgorithmAssignmentOptimization.gh (Grasshopper 1.0.8)

# groupB target
crv = Curve([<curve referenced from the Rhino model> x11])
# groupA repository
# groupA and groupB should have same number of curves
crv_2 = Curve([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])
disc = Discontinuity(Curve=crv, Level=1)  # -> Points, Parameters
shatter = Shatter(Curve=graft(crv), Parameters=disc.Parameters)  # -> simplify(Segments)
item = ListItem(List=shatter, Index=0, Wrap=True)  # -> Item, Item1
pl = PlaneNormal(Origin=Point(0, 0, 0), ZAxis=Vector(0, 0, 1))
area = Area(Geometry=crv)  # -> Area, Centroid
xy = XYPlane(Origin=Point(0, 0, 0))
pl_2 = ConstructPlane(Origin=area.Centroid, XAxis=flatten(item.Item), YAxis=flatten(item.Item1))
orient = Orient(Geometry=crv, Source=pl_2, Target=xy)  # -> Geometry, Transform
crv_3 = Curve(flatten(crv_2))
# the angle between vectors
number_slider = Slider(10, range=0..10)
area_2 = Area(Geometry=orient.Geometry)  # -> Area, Centroid
area_3 = Area(Geometry=crv_3)  # -> Area, Centroid
division = Division(A="360", B=number_slider)
X = UnitX(Factor=1)
series = Series(Start=0, Step=number_slider, Count=division)
Z = UnitZ(Factor=1)
vrot = Rotate(Vector=X, Axis=Z, Angle=degrees(series))
X_2 = UnitX(Factor=1)
series_2 = Series(Start=0, Step=number_slider, Count=division)
Z_2 = UnitZ(Factor=1)
# increase this if the vector does not intersect with edge
number_slider_2 = Slider(2000, range=0..2000)
vrot_2 = Rotate(Vector=X_2, Axis=Z_2, Angle=degrees(series_2))
line = LineSDL(Start=graft(area_3.Centroid), Direction=vrot, Length=number_slider_2)
ccx = CurveCurve(CurveA=graft(crv_3), CurveB=line)  # -> Points, ParamsA, ParamsB
line_2 = LineSDL(Start=graft(area_2.Centroid), Direction=vrot_2, Length=number_slider_2)
# vectors to all directions
trim = TrimTree(Tree=ccx.Points, Depth=1)
ccx_2 = CurveCurve(CurveA=graft(orient.Geometry), CurveB=line_2)  # -> Points, ParamsA, ParamsB
vec2pt = Vector2Pt(PointA=graft(area_3.Centroid), PointB=trim, Unitize=False)  # -> Vector, Length
trim_2 = TrimTree(Tree=ccx_2.Points, Depth=1)
ln = Line(StartPoint=graft(area_3.Centroid), EndPoint=trim)
vec2pt_2 = Vector2Pt(PointA=graft(area_2.Centroid), PointB=trim_2, Unitize=False)  # -> Vector, simplify(Length)
data = Data(simplify(vec2pt.Length))
series_3 = Series(Start=Slider(1, range=0..1), Step=1, Count=expr("x-1", division))
c_script = CSharpScript(vecLengthA=data, vecLengthB=data)  # -> out, A; inputs vecLengthA: tree of Double, vecLengthB: tree of Double
# ---------- c_script: C# ----------
    // Create a new DataTree to store the differences
    DataTree<double> differences = new DataTree<double>();

    // Iterate through each branch of vecLengthA
    for (int i = 0; i < vecLengthA.BranchCount; i++)
    {
      // Get the current branch of vecLengthA
      List<double> branchA = vecLengthA.Branch(i);

      // Cross-reference with each branch of vecLengthB
      for (int j = 0; j < vecLengthB.BranchCount; j++)
      {
        // Get the current branch of vecLengthB
        List<double> branchB = vecLengthB.Branch(j);

        // Compare elements in the branches


        if (branchA.Count == branchB.Count)
        {
          // Compare elements in the branches
          for (int k = 0; k < branchA.Count; k++)
          {
            // Calculate the difference between corresponding elements
            double difference = Math.Abs(branchA[k] - branchB[k]);

            // Add the difference to the new DataTree
            GH_Path path = new GH_Path(i, j);  // Set the path for the result tree
            differences.Add(difference, path);
          }
        }

    



      }
    }


    // Set the output
    A = differences;
# ---------- end c_script ----------
ln_2 = Line(StartPoint=graft(area_2.Centroid), EndPoint=trim_2)
c_script_2 = CSharpScript(vecLengthA=data, vecLengthB=vec2pt_2.Length)  # -> out, A; inputs vecLengthA: tree of Double, vecLengthB: tree of Double
# ---------- c_script_2: C# ----------
    // Create a new DataTree to store the differences
    DataTree<double> differences = new DataTree<double>();
    
    // Iterate through each branch of vecLengthA
    for (int i = 0; i < vecLengthA.BranchCount; i++)
    {
      // Get the current branch of vecLengthA
      List<double> branchA = vecLengthA.Branch(i);
      int n = branchA.Count;
      // Cross-reference with each branch of vecLengthB
      for (int j = 0; j < vecLengthB.BranchCount; j++)
      {
        // Get the current branch of vecLengthB
        List<double> branchB = vecLengthB.Branch(j);

        // Compare elements in the branches


        if (branchA.Count == branchB.Count)
        {
          // Compare elements in the branches
          for (int k = 0; k < branchA.Count; k++)
          {
            // Calculate the difference between corresponding elements
            double difference = Math.Abs(branchA[k] - branchB[k]);

            // Add the difference to the new DataTree
            GH_Path path = new GH_Path(i, j);  // Set the path for the result tree
            differences.Add(difference, path);
          }
        }





      }
    }


    // Set the output
    A = differences;
# ---------- end c_script_2 ----------
shift = ShiftList(List=vec2pt.Length, Shift=series_3, Wrap=True)  # -> simplify(List)
# The sum of absolute deviations
abs = Absolute(Value=c_script.A)
c_script_3 = CSharpScript(vecLengthA=data, vecLengthB=vec2pt_2.Length)  # -> out, A, B; inputs vecLengthA: tree of Double, vecLengthB: tree of Double
# ---------- c_script_3: C# ----------
    DataTree<double> minDifferences = new DataTree<double>();
    DataTree<int> shiftCounts = new DataTree<int>();

    // Iterate through each branch of vecLengthA
    for (int i = 0; i < vecLengthA.BranchCount; i++)
    {
        // Get the current branch of vecLengthA and vecLengthB
        List<double> branchA = vecLengthA.Branch(i);
        List<double> branchB = vecLengthB.Branch(i);

        int n = branchA.Count;
        double minDifference = double.MaxValue;
        int bestShift = 0;

        // Shift loop for simulating rotation (up to n-1 shifts)
        for (int shift = 0; shift < n; shift++)
        {
            // Create a shifted version of branchA
            List<double> shiftedBranchA = new List<double>(branchA);

            // Apply circular shift by removing elements and re-adding them at the end
            for (int s = 0; s < shift; s++)
            {
                double firstElement = shiftedBranchA[0];
                shiftedBranchA.RemoveAt(0);
                shiftedBranchA.Add(firstElement);
            }

            // Calculate the absolute differences for this shifted state
            double totalDifference = 0;
            for (int j = 0; j < n; j++)
            {
                totalDifference += Math.Abs(shiftedBranchA[j] - branchB[j]);
            }

            // Check if the current shift has the smallest difference so far
            if (totalDifference < minDifference)
            {
                minDifference = totalDifference;
                bestShift = shift;
            }
        }

        // Store the smallest difference and the best shift count for the current branch
        minDifferences.Add(minDifference, vecLengthA.Path(i));
        shiftCounts.Add(bestShift, vecLengthA.Path(i));
    }

    // Output the results
    A = minDifferences;
    B = shiftCounts;
# ---------- end c_script_3 ----------
# create a Matrix: sum of deviation against index of group B
ma = MassAddition(Input=abs)  # -> simplify(Result), PartialResults
trim_3 = TrimTree(Tree=ma.Result, Depth=1)
# groupB target
panel = Panel(c_script_3.B)
panel_2 = Panel(c_script_3.A)
int = Integer(trim_3)
panel_3 = Panel(c_script.A)
panel_4 = Panel(int)
hungarianassignment = CSharpScript(costMatrix=int)  # -> out, A, xIndices; inputs costMatrix: tree of Int32
# ---------- hungarianassignment: C# usings ----------
using System.IO;
using System.Linq;
using System.Data;
using System.Drawing;
using System.Reflection;
using System.Windows.Forms;
using System.Xml;
using System.Xml.Linq;
using System.Runtime.InteropServices;

using Rhino.DocObjects;
using Rhino.Collections;
using GH_IO;
using GH_IO.Serialization;
# ---------- hungarianassignment: C# ----------
    int[,] CM = new int[costMatrix.BranchCount, costMatrix.Branch(0).Count];

    for(int i = 0; i < costMatrix.BranchCount;i++)
    {
      for (int j = 0; j < costMatrix.Branch(i).Count;j++)
      {
        CM[i, j] = costMatrix.Branch(i)[j];

      }
    }
    HungarianAlgorithm HA = new HungarianAlgorithm(CM);

    xIndices = HA.Run();
# ---------- hungarianassignment: C# additional code ----------
  /*
  C# hungarian algorithm implementation
  Copyright (C) 2015  Ivan Jurin

  This program is free software; you can redistribute it and/or modify
  it under the terms of the GNU General Public License as published by
  the Free Software Foundation; either version 2 of the License, or
  (at your option) any later version.

  This program is distributed in the hope that it will be useful,
  but WITHOUT ANY WARRANTY; without even the implied warranty of
  MERCHANTABILITY or FITNESS FOR A PARTICULAR PURPOSE.  See the
  GNU General Public License for more details.

  You should have received a copy of the GNU General Public License along
  with this program; if not, write to the Free Software Foundation, Inc.,
  51 Franklin Street, Fifth Floor, Boston, MA 02110-1301 USA.
  */


  public sealed class HungarianAlgorithm
  {
    private readonly int[,] _costMatrix;
    private int _inf;
    private int _n; //number of elements
    private int[] _lx; //labels for workers
    private int[] _ly; //labels for jobs
    private bool[] _s;
    private bool[] _t;
    private int[] _matchX; //vertex matched with x
    private int[] _matchY; //vertex matched with y
    private int _maxMatch;
    private int[] _slack;
    private int[] _slackx;
    private int[] _prev; //memorizing paths

    /// <summary>
    ///
    /// </summary>
    /// <param name="costMatrix"></param>
    public HungarianAlgorithm(int[,] costMatrix)
    {
      _costMatrix = costMatrix;
    }

    /// <summary>
    ///
    /// </summary>
    /// <returns></returns>
    public int[] Run()
    {
      _n = _costMatrix.GetLength(0);

      _lx = new int[_n];
      _ly = new int[_n];
      _s = new bool[_n];
      _t = new bool[_n];
      _matchX = new int[_n];
      _matchY = new int[_n];
      _slack = new int[_n];
      _slackx = new int[_n];
      _prev = new int[_n];
      _inf = int.MaxValue;


      InitMatches();

      if (_n != _costMatrix.GetLength(1))
        return null;

      InitLbls();

      _maxMatch = 0;

      InitialMatching();

      var q = new Queue<int>();

      #region augment

      while (_maxMatch != _n)
      {
        q.Clear();

        InitSt();
        //Array.Clear(S,0,n);
        //Array.Clear(T, 0, n);


        //parameters for keeping the position of root node and two other nodes
        var root = 0;
        int x;
        var y = 0;

        //find root of the tree
        for (x = 0; x < _n; x++)
        {
          if (_matchX[x] != -1) continue;
          q.Enqueue(x);
          root = x;
          _prev[x] = -2;

          _s[x] = true;
          break;
        }

        //init slack
        for (var i = 0; i < _n; i++)
        {
          _slack[i] = _costMatrix[root, i] - _lx[root] - _ly[i];
          _slackx[i] = root;
        }

        //finding augmenting path
        while (true)
        {
          while (q.Count != 0)
          {
            x = q.Dequeue();
            var lxx = _lx[x];
            for (y = 0; y < _n; y++)
            {
              if (_costMatrix[x, y] != lxx + _ly[y] || _t[y]) continue;
              if (_matchY[y] == -1) break; //augmenting path found!
              _t[y] = true;
              q.Enqueue(_matchY[y]);

              AddToTree(_matchY[y], x);
            }
            if (y < _n) break; //augmenting path found!
          }
          if (y < _n) break; //augmenting path found!
          UpdateLabels(); //augmenting path not found, update labels

          for (y = 0; y < _n; y++)
          {
            //in this cycle we add edges that were added to the equality graph as a
            //result of improving the labeling, we add edge (slackx[y], y) to the tree if
            //and only if !T[y] &&  slack[y] == 0, also with this edge we add another one
            //(y, yx[y]) or augment the matching, if y was exposed

            if (_t[y] || _slack[y] != 0) continue;
            if (_matchY[y] == -1) //found exposed vertex-augmenting path exists
            {
              x = _slackx[y];
              break;
            }
            _t[y] = true;
            if (_s[_matchY[y]]) continue;
            q.Enqueue(_matchY[y]);
            AddToTree(_matchY[y], _slackx[y]);
          }
          if (y < _n) break;
        }

        _maxMatch++;

        //inverse edges along the augmenting path
        int ty;
        for (int cx = x, cy = y; cx != -2; cx = _prev[cx], cy = ty)
        {
          ty = _matchX[cx];
          _matchY[cy] = cx;
          _matchX[cx] = cy;
        }
      }

      #endregion

      return _matchX;
    }

    private void InitMatches()
    {
      for (var i = 0; i < _n; i++)
      {
        _matchX[i] = -1;
        _matchY[i] = -1;
      }
    }

    private void InitSt()
    {
      for (var i = 0; i < _n; i++)
      {
        _s[i] = false;
        _t[i] = false;
      }
    }

    private void InitLbls()
    {
      for (var i = 0; i < _n; i++)
      {
        var minRow = _costMatrix[i, 0];
        for (var j = 0; j < _n; j++)
        {
          if (_costMatrix[i, j] < minRow) minRow = _costMatrix[i, j];
          if (minRow == 0) break;
        }
        _lx[i] = minRow;
      }
      for (var j = 0; j < _n; j++)
      {
        var minColumn = _costMatrix[0, j] - _lx[0];
        for (var i = 0; i < _n; i++)
        {
          if (_costMatrix[i, j] - _lx[i] < minColumn) minColumn = _costMatrix[i, j] - _lx[i];
          if (minColumn == 0) break;
        }
        _ly[j] = minColumn;
      }
    }

    private void UpdateLabels()
    {
      var delta = _inf;
      for (var i = 0; i < _n; i++)
        if (!_t[i])
          if(delta > _slack[i])
            delta = _slack[i];
      for (var i = 0; i < _n; i++)
      {
        if (_s[i])
          _lx[i] = _lx[i] + delta;
        if (_t[i])
          _ly[i] = _ly[i] - delta;
        else _slack[i] = _slack[i] - delta;
      }
    }

    private void AddToTree(int x, int prevx)
    {
      //x-current vertex, prevx-vertex from x before x in the alternating path,
      //so we are adding edges (prevx, matchX[x]), (matchX[x],x)

      _s[x] = true; //adding x to S
      _prev[x] = prevx;

      var lxx = _lx[x];
      //updateing slack
      for (var y = 0; y < _n; y++)
      {
        if (_costMatrix[x, y] - lxx - _ly[y] >= _slack[y]) continue;
        _slack[y] = _costMatrix[x, y] - lxx - _ly[y];
        _slackx[y] = x;
      }
    }

    private void InitialMatching()
    {
      for (var x = 0; x < _n; x++)
      {
        for (var y = 0; y < _n; y++)
        {
          if (_costMatrix[x, y] != _lx[x] + _ly[y] || _matchY[y] != -1) continue;
          _matchX[x] = y;
          _matchY[y] = x;
          _maxMatch++;
          break;
        }
      }
    }
    
  }
# ---------- end hungarianassignment ----------
# rearrange groupB
item_2 = ListItem(List=flatten(orient.Geometry), Index=hungarianassignment.xIndices, Wrap=True)
int_2 = Integer(hungarianassignment.xIndices)
panel_5 = Panel(int_2)
inverse = InverseTransform(Transform=orient.Transform)
item_3 = ListItem(List=flatten(inverse), Index=hungarianassignment.xIndices, Wrap=True)
transform = Transform(Geometry=item_2, Transform=item_3)
crv_4 = Curve(crv_3)
# rearrange groupB
disc_2 = Discontinuity(Curve=transform, Level=1)  # -> Points, Parameters
area_4 = Area(Geometry=item_2)  # -> Area, Centroid
area_5 = Area(Geometry=crv_4)  # -> Area, Centroid
area_6 = Area(Geometry=crv_3)  # -> Area, Centroid
xy_2 = XYPlane(Origin=area_5.Centroid)
shatter_2 = Shatter(Curve=graft(transform), Parameters=disc_2.Parameters)  # -> simplify(Segments)
area_7 = Area(Geometry=transform)  # -> Area, Centroid
item_4 = ListItem(List=shatter_2, Index=0, Wrap=True)  # -> Item, Item1
ln_3 = Line(StartPoint=area_6.Centroid, EndPoint=area_4.Centroid)
# match A to B
pl_3 = ConstructPlane(Origin=area_7.Centroid, XAxis=flatten(item_4.Item), YAxis=flatten(item_4.Item1))
# match A to B
orient_2 = Orient(Geometry=crv_4, Source=xy_2, Target=pl_3)  # -> Geometry, Transform
move = Move(Geometry=crv_3, Motion=ln_3)  # -> Geometry, Transform
