# Grasshopper definition 04_Timber aggregation v2.gh (Grasshopper 1.0.8)
# plug-ins: Pufferfish, OpenNest

crv = Curve(<curve referenced from the Rhino model>)
mesh = Mesh(<mesh referenced from the Rhino model>)
# Timber Dimension
number_slider = Slider(6, range=0..10)

number_slider_2 = Slider(19, range=0..100)
number_slider_3 = Slider(100, range=0..100)

# ----
# Overlapping Distance
# Number of layers
number_slider_4 = Slider(40, range=0..100)
# X Axis Gap
number_slider_5 = Slider(3, range=0..10)
# Gap to Concrete
number_slider_6 = Slider(20, range=0..100)

Z = UnitZ(Factor=Slider(0, range=0..1000))
addition = Addition(A=number_slider_2, B=Slider(2, range=0..10))
move = Move(Geometry=crv, Motion=Z)  # -> Geometry, Transform
multiplication = Multiplication(A=addition, B="2")
pframe = PerpFrame(Curve=reparameterize(move.Geometry), Parameter="0")
series = Series(Start=0, Step=multiplication, Count=number_slider)
deplane = DeconstructPlane(Plane=pframe)  # -> Origin, XAxis, YAxis, ZAxis
multiplication_2 = Multiplication(A=deplane.XAxis, B=series)
subtraction = Subtraction(A=number_slider_3, B=number_slider_4)
pframe_2 = PerpFrame(Curve=reparameterize(move.Geometry), Parameter="0")
neg = Negative(Value=multiplication_2)
series_2 = Series(Start=0, Step=subtraction, Count=number_slider_5)
deplane_2 = DeconstructPlane(Plane=pframe_2)  # -> Origin, XAxis, YAxis, ZAxis
move_2 = Move(Geometry=move.Geometry, Motion=neg)  # -> Geometry, Transform
multiplication_3 = Multiplication(A=deplane_2.YAxis, B=series_2)
neg_2 = Negative(Value=multiplication_3)
move_3 = Move(Geometry=move_2.Geometry, Motion=graft(neg_2))  # -> Geometry, Transform
pframe_3 = PerpFrame(Curve=reparameterize(move.Geometry), Parameter="0")
deplane_3 = DeconstructPlane(Plane=pframe_3)  # -> Origin, XAxis, YAxis, ZAxis
multiplication_4 = Multiplication(A=deplane_3.XAxis, B=Slider(0, range=0..1000))
multiplication_5 = Multiplication(A=deplane_3.XAxis, B=addition)
neg_3 = Negative(Value=multiplication_4)
neg_4 = Negative(Value=multiplication_5)
dup = DuplicateData(Data=neg_4, Number=number_slider_5, Order=True)
dup_2 = DuplicateData(Data=neg_3, Number=number_slider_5, Order=True)
tstat = TreeStatistics(Tree=move_3.Geometry)  # -> Paths, Length, Count
weave = Weave(Pattern=[0, 1, 0, 1], Stream0=dup_2, Stream1=dup, NullGaps=False)
short = ShortestList(ListA=tstat.Length, ListB=weave, TrimMode=2)  # -> ListA, ListB
move_4 = Move(Geometry=move_3.Geometry, Motion=graft(short.ListB))  # -> Geometry, Transform

# ----
# Adjusting Rotations
curvepoint = PointOnCurve(move_4.Geometry, parameter=0.355)

avr = Average(Input=curvepoint)
line = LineSDL(Start=flatten(avr), Direction=deplane.XAxis, Length=1)  # -> graft(Line)
merge = Merge(Data1=Slider(0, range=0..100), Data2=Slider(10, range=0..18), Data3=Slider(0, range=0..100))  # -> graft(Result)

# ----
# Extend for intersection
number_slider_7 = Slider(459, range=0..500)

rot3d = Rotate3D(Geometry=simplify(move_4.Geometry), Angle=simplify(degrees(merge)), Center=simplify(avr), Axis=simplify(line))  # -> Geometry, Transform
panel = Panel(merge)
crv_2 = Curve(rot3d.Geometry)
tstat_2 = TreeStatistics(Tree=crv_2)  # -> Paths, Length, Count
ext = ExtendCurve(Curve=crv_2, Type=0, Start=number_slider_7, End=Slider(0, range=0..100))
end = EndPoints(Curve=crv_2)  # -> flatten(Start), flatten(End)
series_3 = Series(Start=0, Step=1, Count=tstat_2.Count)
series_4 = Series(Start=0, Step=1, Count=tstat_2.Length)  # -> simplify(Series)
mcx = MeshCurve(Mesh=mesh, Curve=flatten(ext))  # -> Points, Faces
panel_2 = Panel(tstat_2.Count)
pt = Point(end.End)
item = ListItem(List=mcx.Points, Index=0, Wrap=True)  # -> Item1, Item
dom = ConstructDomain(DomainStart=0, DomainEnd=number_slider_2)
dom_2 = ConstructDomain(DomainStart=0, DomainEnd=number_slider_3)
ln = Line(StartPoint=item.Item1, EndPoint=graft(pt))
pframe_4 = PerpFrame(Curve=reparameterize(ln), Parameter="0")
deplane_4 = DeconstructPlane(Plane=pframe_4)  # -> Origin, XAxis, YAxis, ZAxis
concat = Concatenate(FragmentD="[", FragmentA=graft(series_3), FragmentC="]", FragmentB=series_4)
pl = ConstructPlane(Origin=deplane_4.Origin, XAxis=deplane_4.YAxis, YAxis=deplane_4.ZAxis)
len = Length(Curve=ln)
rectangle = Rectangle(Plane=pl, XSize=dom_2, YSize=len, Radius=0)  # -> Rectangle, Length
panel_3 = Panel(concat)
dam = DataDam(DataA=rectangle.Rectangle, BufferDelay=10000000, BufferMode=0)
item_2 = ListItem(List=flatten(dam), Index=0, Wrap=True)
disc = Discontinuity(Curve=dam, Level=1)  # -> Points, Parameters
shatter = Shatter(Curve=dam, Parameters=disc.Parameters)
# Intersection line
boundary = BoundarySurfaces(Edges=dam)
offmsh = OffsetMesh(Mesh=mesh, Distance=number_slider_6, BothSides=0, CreateSolid=False)
item_3 = ListItem(List=shatter, Index=0, Wrap=True)  # -> Item, Item1, Item2, Item3
mmx = MeshMesh(MeshA=boundary, MeshB=offmsh)
crv_3 = Curve(item_3.Item2)
boxrec = BoxRectangle(Rectangle=dam, Height=dom)
flip = FlipCurve(Curve=mmx, Guide=crv_3)  # -> Curve, Flag
loft = Loft(
    Curves=[crv_3, flip.Curve],
    Options={Adjust=False, Closed=False, LoftEnds=0, LoftSimp=0, LoftType=0, Rebuild=10, Refit=0.01})

partition = PartitionList(List=flatten(loft), Size=number_slider)  # disabled
panel_4 = Panel("0")  # disabled
panel_5 = Panel("1")  # disabled
panel_6 = Panel("1")  # disabled
panel_7 = Panel("2")  # disabled
branch = TreeBranch(Tree=simplify(partition), Path=panel_5, MaintainPaths=True)  # disabled
branch_2 = TreeBranch(Tree=simplify(partition), Path=panel_4, MaintainPaths=True)  # disabled
branch_3 = TreeBranch(Tree=simplify(partition), Path=panel_7, MaintainPaths=True)  # disabled
branch_4 = TreeBranch(Tree=simplify(partition), Path=panel_6, MaintainPaths=True)  # disabled
rint = RegionIntersection(CurvesA=branch_2, CurvesB=branch, Plane=item_2)  # disabled
rint_2 = RegionIntersection(CurvesA=branch_4, CurvesB=branch_3, Plane=item_2)  # disabled
item_4 = ListItem(List=flatten(rint), Index=0, Wrap=True)  # disabled
item_5 = ListItem(List=flatten(rint_2), Index=0, Wrap=True)  # disabled
area = Area(Geometry=item_4)  # -> Area, flatten(Centroid); disabled
area_2 = Area(Geometry=item_5)  # -> Area, flatten(Centroid); disabled
number_slider_8 = Slider(100, range=0..100)  # disabled
number_slider_9 = Slider(100, range=0..100)  # disabled
item_6 = ListItem(List=series, Index=0, Wrap=True)  # -> Item1, Item; disabled
item_7 = ListItem(List=series, Index=0, Wrap=True)  # -> Item1, Item; disabled
neg_5 = Negative(Value=item_6.Item1)  # disabled
neg_6 = Negative(Value=item_7.Item1)  # disabled
line_2 = LineSDL(Start=area.Centroid, Direction=deplane.XAxis, Length=neg_5)  # disabled
number_slider_10 = Slider(4, range=0..10)  # disabled
line_3 = LineSDL(Start=area_2.Centroid, Direction=deplane.XAxis, Length=neg_6)  # disabled
number_slider_11 = Slider(4, range=0..10)  # disabled
number_slider_12 = Slider(20, range=0..100)  # disabled
number_slider_13 = Slider(20, range=0..100)  # disabled
number_slider_14 = Slider(20, range=0..100)  # disabled
number_slider_15 = Slider(20, range=0..100)  # disabled
number_slider_16 = Slider(4, range=0..10)  # disabled
ext_2 = ExtendCurve(Curve=line_2, Type=0, Start=number_slider_12, End=number_slider_13)  # disabled
ext_3 = ExtendCurve(Curve=line_3, Type=0, Start=number_slider_14, End=number_slider_15)  # disabled
pipe = Pipe(Curve=ext_2, Radius=number_slider_10, Caps=2)  # disabled
pipe_2 = Pipe(Curve=ext_3, Radius=number_slider_16, Caps=2)  # disabled
swatch = ColourSwatch(SwatchColor=RGB(255, 218, 94))  # disabled
preview = CustomPreview(Geometry=[pipe, pipe_2], Material=swatch)  # disabled

multiplication_6 = Multiplication(A=deplane_4.XAxis, B=number_slider_2)
number_slider_17 = Slider(100, range=0..100)
multiplication_7 = Multiplication(A=series_3, B=Slider(1000, range=0..1000))
lng = ListLength(List=crv_2)
extr = Extrude(Base=loft, Direction=multiplication_6)
series_5 = Series(Start=0, Step=Slider(300, range=0..1000), Count=lng)
pt_2 = ConstructPoint(XCoordinate=simplify(series_5), YCoordinate=simplify(graft(multiplication_7)), ZCoordinate=0)
xy = XYPlane(Origin=pt_2)
partition_2 = PartitionList(List=flatten(extr), Size=number_slider)
partition_3 = PartitionList(List=flatten(boxrec), Size=number_slider)
panel_8 = Panel(pt_2)
orient = Orient(Geometry=flatten(extr), Source=flatten(pl), Target=flatten(xy))  # -> Geometry, Transform
tag = TextTag(Location=xy, Text=flatten(concat))
text = Text(Location=xy, Text=flatten(concat), Size=Slider(15, range=0..100))
merge_2 = Merge(
    Data1=ColourSwatch(SwatchColor=RGB(112, 88, 9)),
    Data2=ColourSwatch(SwatchColor=RGB(186, 151, 34)),
    Data3=ColourSwatch(SwatchColor=RGB(255, 218, 94)))  # -> graft(Result)
preview_2 = CustomPreview(Geometry=partition_3, Material=merge_2)
